test file "AccelPdl"

suite "New Test Suite 1"

  case "AP1-1_ArbitratedPdlPos0" [baseline]
    model AccelPdl, start time 0, stop time 33
    input "ModelInputs.mat", mapped to Accelerator Pedal Position Primary, Accelerator Pedal Position Secondary, Brake Pedal Position, EDU Fault, Gear Selector (active)
    assessment "Silmutaneous Input Logic": At any point of time, whenever AccelPedalPos > 0.5 & BrakePedalPos > 0.5 is true then, with no delay, SilmInputStatus == logical(1) must be true
    assessment "Test Arbitrated Position = 0": At any point of time, whenever SilmInputStatus == logical(1) | EDUfault == logical(1) | AccelPdl_Fault == logical(1) is true then, with no delay, ArbitPedalPos == 0 must be true
      AccelPedalPos: signal AccelPdl/Accelerator Pedal Position Primary, port 1
      BrakePedalPos: signal AccelPdl/Brake Pedal Position, port 1
      SilmInputStatus: signal AccelPdl/Simultanious Input Check/AND, port 1
      EDUfault: signal AccelPdl/EDU Fault, port 1
      AccelPdl_Fault: signal AccelPdl/From, port 1
      ArbitPedalPos: signal AccelPdl/Arbitrated Pedal Value Determination/Switch, port 1

  case "AP2-2_ArbitratedPdlPosEqualToPrimary" [baseline]
    model AccelPdl, start time 0, stop time 33
    input "ModelInputs.mat", mapped to Accelerator Pedal Position Primary, Accelerator Pedal Position Secondary, Brake Pedal Position, EDU Fault, Gear Selector (active)
    assessment "Test": At any point of time, whenever SimultaneousInputStatus == logical(0) & EDUFault == logical(0) & AccelPdlFault == logical(0) is true then, with no delay, ArbitratedPedalPosition == AcceleratorPrimaryPedalPos must be true
      SimultaneousInputStatus: signal AccelPdl/Simultanious Input Check, port 1
      AccelPdlFault: signal AccelPdl/From, port 1
      EDUFault: signal AccelPdl/EDU Fault, port 1
      ArbitratedPedalPosition: signal AccelPdl/Arbitrated Pedal Value Determination/Switch, port 1
      AcceleratorPrimaryPedalPos: signal AccelPdl/Accelerator Pedal Position Primary, port 1

  case "AP3-3_EffAndActualPdlPosEqualToArbPdlPos" [baseline]
    model AccelPdl, start time 0, stop time 33
    input "ModelInputs.mat", mapped to Accelerator Pedal Position Primary, Accelerator Pedal Position Secondary, Brake Pedal Position, EDU Fault, Gear Selector (active)
    assessment "EffectivePedalPos = ArbitratedPedalPos": At any point of time, EffectivePedalPos == ArbitratedPedalPos must be true
    assessment "ActualPedalPos = ArbitratedPedalPos": At any point of time, ActualPedalPos == ArbitratedPedalPos must be true
      EffectivePedalPos: signal AccelPdl/Primary Logic, port 1
      ArbitratedPedalPos: signal AccelPdl/Arbitrated Pedal Value Determination/Switch, port 1
      ActualPedalPos: signal AccelPdl/Primary Logic, port 2

  case "AP4-4_0TorqueNeutral" [baseline]
    model AccelPdl, start time 0, stop time 33
    input "ModelInputs.mat", mapped to Accelerator Pedal Position Primary, Accelerator Pedal Position Secondary, Brake Pedal Position, EDU Fault, Gear Selector (active)
    assessment "Assessment1": At any point of time, whenever ArbitratedPdlPos ~= 0 & GearSelector == 5 is true then, with no delay, WheelTorque == 0 must be true
      GearSelector: signal AccelPdl/Gear Selector, port 1
      WheelTorque: signal AccelPdl/Primary Logic, port 3
      ArbitratedPdlPos: signal AccelPdl/Arbitrated Pedal Value Determination/Switch, port 1

  case "AP5-5_0TorquePark" [baseline]
    model AccelPdl, start time 0, stop time 33
    input "ModelInputs.mat", mapped to Accelerator Pedal Position Primary, Accelerator Pedal Position Secondary, Brake Pedal Position, EDU Fault, Gear Selector (active)
    assessment "Assessment1": At any point of time, whenever ArbitratedPdlPos ~= 0 & GearSelector == 1 is true then, with no delay, WheelTorque == 0 must be true
      GearSelector: signal AccelPdl/Gear Selector, port 1
      WheelTorque: signal AccelPdl/Primary Logic, port 3
      ArbitratedPdlPos: signal AccelPdl/Arbitrated Pedal Value Determination/Switch, port 1

  case "AP6-6_PositiveTorque" [baseline]
    model AccelPdl, start time 0, stop time 33
    input "ModelInputs.mat", mapped to Accelerator Pedal Position Primary, Accelerator Pedal Position Secondary, Brake Pedal Position, EDU Fault, Gear Selector (active)
    assessment "Assessment1": At any point of time, whenever GearSelector == 7 is true then, with no delay, WheelTorque > 0 must be true
      GearSelector: signal AccelPdl/Gear Selector, port 1
      WheelTorque: signal AccelPdl/Primary Logic, port 3

  case "AP7-7_NegativeTorque" [baseline]
    model AccelPdl, start time 0, stop time 33
    input "ModelInputs.mat", mapped to Accelerator Pedal Position Primary, Accelerator Pedal Position Secondary, Brake Pedal Position, EDU Fault, Gear Selector (active)
    assessment "Assessment1": At any point of time, whenever GearSelector == 3 is true then, with no delay, WheelTorque < 0 must be true
      GearSelector: signal AccelPdl/Gear Selector, port 1
      WheelTorque: signal AccelPdl/Primary Logic, port 3

  case "AP8-8_DisagreementFault1" [baseline]
    model AccelPdl, start time 0, stop time 33
    input "ModelInputs.mat", mapped to Accelerator Pedal Position Primary, Accelerator Pedal Position Secondary, Brake Pedal Position, EDU Fault, Gear Selector (active)
    assessment "Assessment1": At any point of time, whenever AccelPedposPri ~= AccelPedposSec is true then, with no delay, DisagreementFault == logical(1) must be true
      AccelPedposPri: signal AccelPdl/Disagreement Logic/Accelerator Pedal Position Primary, port 1
      AccelPedposSec: signal AccelPdl/Disagreement Logic/Accelerator Pedal Position Secondary, port 1
      DisagreementFault: signal AccelPdl/Disagreement Logic/NotEqual, port 1

  case "AP9-9_PrimaryOutOfRangeFault1" [baseline]
    model AccelPdl, start time 0, stop time 33
    input "ModelInputs.mat", mapped to Accelerator Pedal Position Primary, Accelerator Pedal Position Secondary, Brake Pedal Position, EDU Fault, Gear Selector (active)
    assessment "Assessment1": At any point of time, whenever AccelPdlPosPri < 0 | AccelPdlPosPri > 100 is true then, with no delay, PrimaryOOR == logical(1) must be true
      AccelPdlPosPri: signal AccelPdl/OOR Logic: Primary Pedal/Accelerator Pedal Position Primary, port 1
      PrimaryOOR: signal AccelPdl/OOR Logic: Primary Pedal/OR, port 1

  case "AP10-10_SecondaryOutOfRangeFault1" [baseline]
    model AccelPdl, start time 0, stop time 33
    input "ModelInputs.mat", mapped to Accelerator Pedal Position Primary, Accelerator Pedal Position Secondary, Brake Pedal Position, EDU Fault, Gear Selector (active)
    assessment "Assessment1": At any point of time, whenever AccelPdlPosSec < 0 | AccelPdlPosSec > 100 is true then, with no delay, SecondaryOOR == logical(1) must be true
      AccelPdlPosSec: signal AccelPdl/OOR Logic: Secondary Pedal/Accelerator Pedal Position Secondary, port 1
      SecondaryOOR: signal AccelPdl/OOR Logic: Secondary Pedal/OR, port 1

  case "AP11-11_AcceleratorPedalFault1" [baseline]
    model AccelPdl, start time 0, stop time 33
    input "ModelInputs.mat", mapped to Accelerator Pedal Position Primary, Accelerator Pedal Position Secondary, Brake Pedal Position, EDU Fault, Gear Selector (active)
    assessment "Assessment1": At any point of time, whenever PrimaryOOR == logical(1) | SecondaryOOR == logical(1) | PedalDisagreement == logical(1) is true then, with no delay, AccelPdlFault == logical(1) must be true
      PrimaryOOR: signal AccelPdl/Acceleraor Pedal Fault Logic/Primary Pedal OOR Fault, port 1
      SecondaryOOR: signal AccelPdl/Acceleraor Pedal Fault Logic/Secondary Pedal OOR Fault, port 1
      PedalDisagreement: signal AccelPdl/Acceleraor Pedal Fault Logic/Pedal Disagreement Fault, port 1
      AccelPdlFault: signal AccelPdl/Acceleraor Pedal Fault Logic/OR, port 1