# Requirement set Accel_Pdl (R2023a)
Requirements Testing Round

## 1 [AP 1] If any of the following situations occur, the arbitrated pedal position must be 0.
1. If any of the following situations occur, the arbitrated pedal position must be 0.
- Simultaneous Input of Brake Pedal and Accelerator Pedal Primary is detected
- EDU fault is present
- Accelerator fault is present

## 2 [AP 2] If none of these situations occur, the Arbitrated Pedal Position must be equal to Accelerator Pedal Position Primary.
2. In the case that none of the following situations occur, the Arbitrated Pedal Position must be equal to Accelerator Pedal Position Primary.
- Simultaneous Input of Brake Pedal and Accelerator Pedal Primary is detected
- EDU fault is present
- Accelerator fault is present

## 3 [AP 3] Effective Pedal Position and Actual Pedal Position Must Always Equal Arbitrated Pedal Position
3. Effective Pedal Position AND Actual Pedal Position MUST always equal Arbitrated Pedal Position.

## 4 [AP 4] 0 torque if accelerator pedal is pressed and the vehicle is in neutral
4. 0 torque should be commended if the accelerator pedal is pressed AND the vehicle is in neutral.

## 5 [AP 5] 0 torque if accelerator pedal is pressed and vehicle is in park
5. 0 torque should be commended if the accelerator pedal is pressed AND the vehicle is in park.

## 6 [AP 6] Torque is positive in drive
6. When in drive, Torque command must be positive.

## 7 [AP 7] Torque is negative in reverse
6. When in reverse, Torque command must be negative.

## 8 [AP 8] Disagreement fault is 1 if Accelerator Pedal position primary and secondary are different
8. The Disagreement fault MUST have a value of 1 if the Accelerator Pedal position primary and Accelerator Pedal position secondary differ.

## 9 [AP 9] Primary Out of Range Fault is 1 if Primary Pedal Position is less than 0 or greater than 100
9. The Primary Out of Range Fault MUST have a value of 1 if the Primary pedal position is outside the range 0 – 100.

## 10 [AP 10] Secondary Out of Range Fault is 1 if Secondary Pedal Position is less than 0 or greater than 100
10. The Secondary Out Of Range Fault MUST have a value of 1 if the Secondary pedal position is outside the range 0 – 100.

## 11 [AP 11] Accelerator Pedal Fault is 1 if any of the faults occur
11. The Accelerator Pedal Fault MUST have a value of 1 if any of the faults occur
- Disagreement Fault
- Primary OOR Fault
- Secondary OOR Fault