test file "IndicatorBoard"

suite "Indicator Board Requirements Tests"

  case "IB_1_PropulsionSystemLightON" [baseline]
    model IndicatorBoard, start time 0, stop time 22
    input "IB_in_r1_test1.mat", mapped to PropulsionSystemEnabled, Battery_ContactorStatus, KeyCycle_Detected, Isolation_Fault, Regen_Braking_Switch, CAV_LongCtrl_Switch, CAV_LatCtrl_Switch, CAV_V2XCtrl_Switch, Autera12VEnabled, CAV_LongCntrlLightCmd, CAV_LatCntrlLightCmd, CAV_V2XCntrlLightCmd, EDUFault, PropSysFault (active)
    assessment "Assessment1": At any point of time, whenever PropulsionSystemEnabled == 1 & PropulsionSystemFault == 0 is true then, with a delay of at most 0.01, PropulsionSystemStatusLight == 1 must be true
      PropulsionSystemEnabled: signal IndicatorBoard/Chart/SpeedGoat_Run/From, port 1
      PropulsionSystemFault: signal IndicatorBoard/Chart/SpeedGoat_Run/From12, port 1
      PropulsionSystemStatusLight: signal IndicatorBoard/Chart/SpeedGoat_Run/Propulsion System LED, port 1

  case "IB_2_PropulsionSystemLightOFF" [baseline]
    model IndicatorBoard, start time 0, stop time 22
    input "IB_in_r1_test1.mat", mapped to PropulsionSystemEnabled, Battery_ContactorStatus, KeyCycle_Detected, Isolation_Fault, Regen_Braking_Switch, CAV_LongCtrl_Switch, CAV_LatCtrl_Switch, CAV_V2XCtrl_Switch, Autera12VEnabled, CAV_LongCntrlLightCmd, CAV_LatCntrlLightCmd, CAV_V2XCntrlLightCmd, EDUFault, PropSysFault (active)
    assessment "Assessment1": At any point of time, whenever PropulsionSystemEnabled == 0 & PropulsionSystemFault == 0 is true then, with no delay, PropulsionSystemStatusLight == 0 must be true
      PropulsionSystemEnabled: signal IndicatorBoard/Chart/SpeedGoat_Run/From, port 1
      PropulsionSystemFault: signal IndicatorBoard/Chart/SpeedGoat_Run/From12, port 1
      PropulsionSystemStatusLight: signal IndicatorBoard/Chart/SpeedGoat_Run/Propulsion System LED, port 1

  case "IB_3_PropulsionSystemLightFlashing" [baseline]
    model IndicatorBoard, start time 0, stop time 22
    input "IB_in_r1_test1.mat", mapped to PropulsionSystemEnabled, Battery_ContactorStatus, KeyCycle_Detected, Isolation_Fault, Regen_Braking_Switch, CAV_LongCtrl_Switch, CAV_LatCtrl_Switch, CAV_V2XCtrl_Switch, Autera12VEnabled, CAV_LongCntrlLightCmd, CAV_LatCntrlLightCmd, CAV_V2XCntrlLightCmd, EDUFault, PropSysFault (active)
    assessment "Assessment1": At any point of time, whenever PropulsionSystemFault == 1 is true then, with a delay of at most 0.01, PropulsionSystemStatusLight == 2 must be true
      PropulsionSystemFault: signal IndicatorBoard/Chart/SpeedGoat_Run/From12, port 1
      PropulsionSystemStatusLight: signal IndicatorBoard/Chart/SpeedGoat_Run/Propulsion System LED, port 1

  case "IB_4_HVSystemLightON" [baseline]
    model IndicatorBoard, start time 0, stop time 22
    input "IB_in_r1_test1.mat", mapped to PropulsionSystemEnabled, Battery_ContactorStatus, KeyCycle_Detected, Isolation_Fault, Regen_Braking_Switch, CAV_LongCtrl_Switch, CAV_LatCtrl_Switch, CAV_V2XCtrl_Switch, Autera12VEnabled, CAV_LongCntrlLightCmd, CAV_LatCntrlLightCmd, CAV_V2XCntrlLightCmd, EDUFault, PropSysFault (active)
    assessment "Assessment1": At any point of time, whenever Battery_ContactorStatus == 2 & IsoFault == 0 is true then, with no delay, HVSystemLightStatus == 1 must be true
      Battery_ContactorStatus: signal IndicatorBoard/Chart/SpeedGoat_Run/From1, port 1
      IsoFault: signal IndicatorBoard/Chart/SpeedGoat_Run/From2, port 1
      HVSystemLightStatus: signal IndicatorBoard/Chart/SpeedGoat_Run/KeyCycle_Detected, port 1

  case "IB_5_HVSystemLightOFF" [baseline]
    model IndicatorBoard, start time 0, stop time 22
    input "IB_in_r1_test1.mat", mapped to PropulsionSystemEnabled, Battery_ContactorStatus, KeyCycle_Detected, Isolation_Fault, Regen_Braking_Switch, CAV_LongCtrl_Switch, CAV_LatCtrl_Switch, CAV_V2XCtrl_Switch, Autera12VEnabled, CAV_LongCntrlLightCmd, CAV_LatCntrlLightCmd, CAV_V2XCntrlLightCmd, EDUFault, PropSysFault (active)
    assessment "Assessment1": At any point of time, whenever Battery_ContactorStatus == 0 & IsoFault == 0 is true then, with no delay, HVSystemLightStatus == 0 must be true
      Battery_ContactorStatus: signal IndicatorBoard/Chart/SpeedGoat_Run/From1, port 1
      IsoFault: signal IndicatorBoard/Chart/SpeedGoat_Run/From2, port 1
      HVSystemLightStatus: signal IndicatorBoard/Chart/SpeedGoat_Run/HV System LED, port 1

  case "IB_6_HVSystemLightFlashing" [baseline]
    model IndicatorBoard, start time 0, stop time 22
    input "IB_in_r1_test1.mat" (active)
    assessment "Assessment1": At any point of time, whenever IsoFault == 1 is true then, with no delay, HVSystemLightStatus == 2 must be true
      IsoFault: signal IndicatorBoard/Chart/SpeedGoat_Run/From2, port 1
      HVSystemLightStatus: signal IndicatorBoard/Chart/SpeedGoat_Run/HV System LED, port 1

  case "IB_7_LongitudinalControlSystemLightON" [baseline]
    model IndicatorBoard, start time 0, stop time 22
    input "IB_in_r1_test1.mat", mapped to PropulsionSystemEnabled, Battery_ContactorStatus, KeyCycle_Detected, Isolation_Fault, Regen_Braking_Switch, CAV_LongCtrl_Switch, CAV_LatCtrl_Switch, CAV_V2XCtrl_Switch, Autera12VEnabled, CAV_LongCntrlLightCmd, CAV_LatCntrlLightCmd, CAV_V2XCntrlLightCmd, EDUFault, PropSysFault (active)
    assessment "Assessment1": At any point of time, whenever LongitudinalControlLightCommand == 1 & LongitudinalControlSystemSwitch == 1 & Autera == 1 is true then, with a delay of at most 0.01, LongitudinalControlSystemLight == 1 must be true
      LongitudinalControlSystemLight: signal IndicatorBoard/Chart, port 3
      LongitudinalControlSystemSwitch: signal IndicatorBoard/CAV_LongCtrl_Switch, port 1
      LongitudinalControlLightCommand: signal IndicatorBoard/CAV_LongCntrlLightCmd, port 1
      Autera: signal IndicatorBoard/Autera12VEnabled, port 1

  case "IB_8_LongitudinalControlSystemLightOFF" [baseline]
    model IndicatorBoard, start time 0, stop time 22
    input "IB_in_r1_test1.mat", mapped to PropulsionSystemEnabled, Battery_ContactorStatus, KeyCycle_Detected, Isolation_Fault, Regen_Braking_Switch, CAV_LongCtrl_Switch, CAV_LatCtrl_Switch, CAV_V2XCtrl_Switch, Autera12VEnabled, CAV_LongCntrlLightCmd, CAV_LatCntrlLightCmd, CAV_V2XCntrlLightCmd, EDUFault, PropSysFault (active)
    assessment "Assessment1": At any point of time, whenever Autera12VEnbld == 0 | CAV_LongCntrlLightCmd == 0 | CAV_Long_Cntrl_Switch == 0 is true then, with a delay of at most 0.01, LongitudinalControlSystemLight == 0 must be true
      Autera12VEnbld: signal IndicatorBoard/Chart/SpeedGoat_Run/From5, port 1
      CAV_LongCntrlLightCmd: signal IndicatorBoard/Chart/SpeedGoat_Run/From7, port 1
      CAV_Long_Cntrl_Switch: signal IndicatorBoard/Chart/SpeedGoat_Run/From3, port 1
      LongitudinalControlSystemLight: signal IndicatorBoard/Chart/SpeedGoat_Run/CAV Longitudinal Control Status Light, port 1

  case "IB_9_LongitudinalControlSystemLightFLASHING" [baseline]
    model IndicatorBoard, start time 0, stop time 22
    input "IB_in_r1_test1.mat", mapped to PropulsionSystemEnabled, Battery_ContactorStatus, KeyCycle_Detected, Isolation_Fault, Regen_Braking_Switch, CAV_LongCtrl_Switch, CAV_LatCtrl_Switch, CAV_V2XCtrl_Switch, Autera12VEnabled, CAV_LongCntrlLightCmd, CAV_LatCntrlLightCmd, CAV_V2XCntrlLightCmd, EDUFault, PropSysFault (active)
    assessment "Assessment1": At any point of time, whenever Autera12VEnbld == 1 &  CAV_Long_Cntrl_Switch == 1 & CAV_LongCntrlLightCmd == 2 is true then, with a delay of at most 0.01, LongitudinalControlSystemLight == 2 must be true
      Autera12VEnbld: signal IndicatorBoard/Chart/SpeedGoat_Run/From5, port 1
      CAV_Long_Cntrl_Switch: signal IndicatorBoard/Chart/SpeedGoat_Run/From3, port 1
      CAV_LongCntrlLightCmd: signal IndicatorBoard/Chart/SpeedGoat_Run/From7, port 1
      LongitudinalControlSystemLight: signal IndicatorBoard/Chart/SpeedGoat_Run/CAV Longitudinal Control Status Light, port 1

  case "IB_10_CAVLateralControlStatusON" [baseline]
    model IndicatorBoard, start time 0, stop time 22
    input "IB_in_r1_test1.mat", mapped to PropulsionSystemEnabled, Battery_ContactorStatus, KeyCycle_Detected, Isolation_Fault, Regen_Braking_Switch, CAV_LongCtrl_Switch, CAV_LatCtrl_Switch, CAV_V2XCtrl_Switch, Autera12VEnabled, CAV_LongCntrlLightCmd, CAV_LatCntrlLightCmd, CAV_V2XCntrlLightCmd, EDUFault, PropSysFault (active)
    assessment "Assessment1": At any point of time, whenever Autera12VEnbld == 1 & CAV_Lat_Cntrl_Switch == 1 & CAV_LatCntrlLightCmd == 1 is true then, with a delay of at most 0.1, CAVLateralControlStatusON == 1 must be true
      Autera12VEnbld: signal IndicatorBoard/Chart/SpeedGoat_Run/From6, port 1
      CAV_LatCntrlLightCmd: signal IndicatorBoard/Chart/SpeedGoat_Run/From8, port 1
      CAV_Lat_Cntrl_Switch: signal IndicatorBoard/Chart/SpeedGoat_Run/From4, port 1
      CAVLateralControlStatusON: signal IndicatorBoard/Chart/SpeedGoat_Run/CAV Lateral Control Status Light, port 1

  case "IB_11_CAVLateralControlStatusOFF" [baseline]
    model IndicatorBoard, start time 0, stop time 22
    input "IB_in_r1_test1.mat", mapped to PropulsionSystemEnabled, Battery_ContactorStatus, KeyCycle_Detected, Isolation_Fault, Regen_Braking_Switch, CAV_LongCtrl_Switch, CAV_LatCtrl_Switch, CAV_V2XCtrl_Switch, Autera12VEnabled, CAV_LongCntrlLightCmd, CAV_LatCntrlLightCmd, CAV_V2XCntrlLightCmd, EDUFault, PropSysFault (active)
    assessment "Assessment1": At any point of time, whenever Autera12VEnbld == 0 | CAV_LatCntrlLightCmd == 0 |CAV_Lat_Cntrl_Switch == 0 is true then, with a delay of at most 0.1, CAVLateralControlStatusOFF == 0 must be true
      Autera12VEnbld: signal IndicatorBoard/Chart/SpeedGoat_Run/From6, port 1
      CAV_LatCntrlLightCmd: signal IndicatorBoard/Chart/SpeedGoat_Run/From8, port 1
      CAV_Lat_Cntrl_Switch: signal IndicatorBoard/Chart/SpeedGoat_Run/From4, port 1
      CAVLateralControlStatusOFF: signal IndicatorBoard/Chart/SpeedGoat_Run/CAV Lateral Control Status Light, port 1

  case "IB_12_CAVLateralControlStatusFLASHING" [baseline]
    model IndicatorBoard, start time 0, stop time 22
    input "IB_in_r1_test1.mat", mapped to PropulsionSystemEnabled, Battery_ContactorStatus, KeyCycle_Detected, Isolation_Fault, Regen_Braking_Switch, CAV_LongCtrl_Switch, CAV_LatCtrl_Switch, CAV_V2XCtrl_Switch, Autera12VEnabled, CAV_LongCntrlLightCmd, CAV_LatCntrlLightCmd, CAV_V2XCntrlLightCmd, EDUFault, PropSysFault (active)
    assessment "Assessment1": At any point of time, whenever Autera12VEnbld == 1 &  CAV_Lat_Cntrl_Switch == 1 &  CAV_LatCntrlLightCmd == 2 is true then, with a delay of at most 0.1, CAVLateralControlStatusOFF == 2 must be true
      Autera12VEnbld: signal IndicatorBoard/Chart/SpeedGoat_Run/From6, port 1
      CAV_Lat_Cntrl_Switch: signal IndicatorBoard/Chart/SpeedGoat_Run/From4, port 1
      CAV_LatCntrlLightCmd: signal IndicatorBoard/Chart/SpeedGoat_Run/From8, port 1
      CAVLateralControlStatusOFF: signal IndicatorBoard/Chart/SpeedGoat_Run/CAV Lateral Control Status Light, port 1

  case "IB_13_CAVV2XStatusON" [baseline]
    model IndicatorBoard, start time 0, stop time 22
    input "IB_in_r1_test1.mat", mapped to PropulsionSystemEnabled, Battery_ContactorStatus, KeyCycle_Detected, Isolation_Fault, Regen_Braking_Switch, CAV_LongCtrl_Switch, CAV_LatCtrl_Switch, CAV_V2XCtrl_Switch, Autera12VEnabled, CAV_LongCntrlLightCmd, CAV_LatCntrlLightCmd, CAV_V2XCntrlLightCmd, EDUFault, PropSysFault (active)
    assessment "Assessment1": At any point of time, whenever V2XSwitch == 1 & Autera == 1 & ControlLightCmd == 1 is true then, with a delay of at most 0.01, V2XStatusLight == 1 must be true
      V2XSwitch: signal IndicatorBoard/CAV_V2XCtrl_Switch, port 1
      V2XStatusLight: signal IndicatorBoard/Chart, port 5
      Autera: signal IndicatorBoard/Autera12VEnabled, port 1
      ControlLightCmd: signal IndicatorBoard/CAV_V2XCntrlLightCmd, port 1

  case "IB_14_CAVV2XStatusOFF" [baseline]
    model IndicatorBoard, start time 0, stop time 22
    input "IB_in_r1_test1.mat", mapped to PropulsionSystemEnabled, Battery_ContactorStatus, KeyCycle_Detected, Isolation_Fault, Regen_Braking_Switch, CAV_LongCtrl_Switch, CAV_LatCtrl_Switch, CAV_V2XCtrl_Switch, Autera12VEnabled, CAV_LongCntrlLightCmd, CAV_LatCntrlLightCmd, CAV_V2XCntrlLightCmd, EDUFault, PropSysFault (active)
    assessment "Assessment1": At any point of time, whenever V2XSwitch == 0 is true then, with a delay of at most 0.01, V2XStatusLight == 0 must be true
      V2XSwitch: signal IndicatorBoard/CAV_V2XCtrl_Switch, port 1
      V2XStatusLight: signal IndicatorBoard/Chart/SpeedGoat_Run/CAV V2X Control Status Light, port 1

  case "IB_15_CAVV2XStatusFLASHING" [baseline]
    model IndicatorBoard, start time 0, stop time 22
    input "IB_in_r1_test1.mat", mapped to PropulsionSystemEnabled, Battery_ContactorStatus, KeyCycle_Detected, Isolation_Fault, Regen_Braking_Switch, CAV_LongCtrl_Switch, CAV_LatCtrl_Switch, CAV_V2XCtrl_Switch, Autera12VEnabled, CAV_LongCntrlLightCmd, CAV_LatCntrlLightCmd, CAV_V2XCntrlLightCmd, EDUFault, PropSysFault (active)
    assessment "Assessment1": At any point of time, whenever Autera == 1 & V2XSwitch == 1 & V2XControlLightCmd == 2 is true then, with a delay of at most 0.01, V2XStatusLight == 2 must be true
      Autera: signal IndicatorBoard/Autera12VEnabled, port 1
      V2XStatusLight: signal IndicatorBoard/Chart, port 5
      V2XSwitch: signal IndicatorBoard/CAV_V2XCtrl_Switch, port 1
      V2XControlLightCmd: signal IndicatorBoard/CAV_V2XCntrlLightCmd, port 1